# Grasshopper definition coursework_3_grasshopper.gh (Grasshopper 1.0.7)

path = FilePath("C:\Users\Jamie\Documents\MRes\4D2\points_nice3.txt")
path_2 = FilePath("C:\Users\Jamie\Documents\MRes\4D2\edges_0_nice2.txt")
path_3 = FilePath("C:\Users\Jamie\Documents\MRes\4D2\total_bar_forces_nice3.txt")
path_4 = FilePath("C:\Users\Jamie\Documents\MRes\4D2\edges_1_nice2.txt")
file = ReadFile(File=path, PerLineParse=True)
X = UnitX(Factor=Slider(104.8, range=100..200))
txt = Text(path)
panel = Panel(file)
file_2 = ReadFile(File=path_2, PerLineParse=True)
file_3 = ReadFile(File=path_3, PerLineParse=True)
file_4 = ReadFile(File=path_4, PerLineParse=True)
panel_2 = Panel(file_3)
panel_3 = Panel(file_2)
coords = ImportCoordinates(File=path, Separator=",", XIndex=0, YIndex=1, ZIndex=2)
panel_4 = Panel(file_4)
expression = Expression(Expression="Format(\"(π/4)*x^4\", x)")
# Stress (200MPa) in kPa
num = Number(200000)
pt = Point(coords)
abs = Absolute(Value=panel_2)
item = ListItem(List=pt, Index=panel_3, Wrap=True)
ln = Line()
expression_2 = Expression(Expression="Format(\"(((4*π*x/y^2)-1)/((4*π*x/y^2)+1))^0.5\", x,y) ")
abs_2 = Absolute(Value=panel_2)
equals = Equality(FirstNumber=abs_2, SecondNumber=panel_2)  # -> Equality, Inequality
item_2 = ListItem(List=pt, Index=panel_4, Wrap=True)
num_2 = Number(equals.Equality)
expression_3 = Expression(Expression="Format(\"(1*x/π)^0.5\", x)")
num_3 = Number(equals.Inequality)
# Area (m2)
division = Division(A=abs, B=num)
ln_2 = Line(StartPoint=item, EndPoint=item_2)
python = GhPythonScript()  # -> out, a, b; inputs x: list of Vector3d, y: list of Line, z: Point3d
# ---------- python: Python ----------
# sample script to show how to use this component and the rhinoscriptsyntax
"""Constructs a sinusoidal series of circles.
  Inputs:
    x: The number of circles. (integer)
    y: The radius of each circle. (float)
  Outputs:
    a: The list of circles. (list of circle)
    b: The list of radii. (list of float)
"""
import math
import rhinoscriptsyntax as rs



cable_vectors = x
strut_lines = y
start_point = z
end_point = u


all_points = []
larger_points = [start_point]
point_0 = start_point
i = 0
for strut in strut_lines:
    first_point = rs.PointAdd(point_0,cable_vectors[i])
    line1 = rs.AddLine(point_0, first_point)
    next_point = rs.LineLineIntersection(line1,strut_lines[i])[0]
    point_0 = next_point
    all_points.append(next_point)
    larger_points.append(next_point)
    i=i+1
    
larger_points.append(u)
a = all_points
b = larger_points
# ---------- end python ----------
multiplication = Multiplication(A=Slider(0.000225, range=0..0.001), B=abs_2)
frgb = ColourRGBF(Alpha=1, Red=num_2, Green=0, Blue=num_3)
crv = Curve(ln_2)
# E (210GPa) in kPa
num_4 = Number(210000000)
max = Maximum(A=multiplication, B=Slider(0.085423, range=0..0.1))
panel_5 = Panel(division)
# radii
eval = Evaluate(F=expression_3, x=division)
eval_2 = Evaluate(F=expression, x=eval)
multiplication_2 = Multiplication(A=eval_2, B=num_2)
expression_4 = Expression(Expression="Format(\"x*y^2/(z*π^2)\", x,y,z)")
path_5 = FilePath("C:\Users\Jamie\Documents\MRes\4D2\cells_nice2.txt")
path_6 = FilePath("C:\Users\Jamie\Documents\MRes\4D2\latex\ally3.jpg")
len = Length(Curve=ln_2)
img = ImportImage(File=path_6)
rgb = ColourRGB(Alpha=255, Red=0, Green=0, Blue=0)
file_5 = ReadFile(File=path_5, PerLineParse=True)
txt_2 = Text(path_5)
panel_6 = Panel(eval)
image_resource = ImageResource(img)
# required I for comp (m4)
eval_3 = Evaluate(F=expression_4, x=panel_2, y=len, z=num_4)
coords_2 = ImportCoordinates(File=path_5, Separator=",", XIndex=0, YIndex=1, ZIndex=2)
colour = ColourPicker(PickedColour=RGB(51, 132, 138))
num_5 = Number(180)
# get only negative values (compression) and make positive
multiplication_3 = Multiplication(A=eval_3, B=num_3)
num_6 = Number(Slider(222.2, range=220..230))
pdecon = Deconstruct(Point=coords_2)  # -> XComponent, YComponent, ZComponent
num_7 = Number(0.05)
abs_3 = Absolute(Value=multiplication_3)
addition = Addition(A=abs_3, B=multiplication_2)
panel_7 = Panel(addition)
# rho
eval_4 = Evaluate(F=expression_2, x=addition, y=division)
panel_8 = Panel(eval_4)
expression_5 = Expression(x=division, y=eval_4, Expression="Format(If(y>0,\"x/(π*y)\",\"0\"), x,y)")
# t
eval_5 = Evaluate(F=expression_5, x=division, y=eval_4)
panel_9 = Panel(file_5)
addition_2 = Addition(A=num_6, B=num_5)
pt_2 = Point(Point(105.6913809, 176.656956, 0))
max_2 = Maximum(A=eval, B=num_7)
item_3 = ListItem(List=pt, Index=pdecon.ZComponent, Wrap=True)
rad = Radians(Degrees=addition_2)
item_4 = ListItem(List=pt, Index=pdecon.YComponent, Wrap=True)
item_5 = ListItem(List=pt, Index=pdecon.XComponent, Wrap=True)
colour_2 = ColourPicker(PickedColour=RGB(177, 214, 230))
rad_2 = Radians(Degrees=num_6)
Z = UnitZ(Factor=1)
material = CreateMaterial(Diffuse=colour, Specular=colour, Emission=colour, Transparency=0, Shine=0)
expression_6 = Expression(Expression="Format(\"(20*x/π)^0.25\", x)")
entwine = Entwine(Branch00=item_5, Branch01=item_4, Branch02=item_3, FlattenInputs=True)
item_6 = ListItem(List=coords, Index=0, Wrap=True)
vec2pt = Vector2Pt(PointA=item_6, PointB=pt_2, Unitize=False)  # -> Vector, Length
pt_3 = Point(Point(229.225872, 127.7379438, 0))
# radii
eval_6 = Evaluate(F=expression_6, x=abs_3)
bool = Boolean(True)
flip = FlipMatrix(Data=entwine)
line = LineSDL(Start=item_6, Direction=Z, Length=1)
conmesh = ConstructMesh(Vertices=pt, Faces={A=0, B=1, C=2, D=3})
pline = PolyLine(Vertices=flip, Closed=bool)
vec2pt_2 = Vector2Pt(PointA=item_6, PointB=pt_3, Unitize=False)  # -> Vector, Length
multiplication_4 = Multiplication(A=eval_6, B=Slider(1, range=1..10))
boundary = BoundarySurfaces(Edges=pline)
rotax = RotateAxis(Geometry=boundary, Angle=rad, Axis=line)  # -> Geometry, Transform
expression_7 = Expression(Expression="Format(\"(10*x/π)^0.5\", x)")
expression_8 = Expression(Expression="Format(\"(π*x^2)/20\", x)")
rotax_2 = RotateAxis(Geometry=boundary, Angle=rad_2, Axis=line)  # -> Geometry, Transform
boundary_2 = BoundarySurfaces()
material_2 = CreateMaterial(
    Diffuse=colour_2,
    Specular=colour_2,
    Emission=colour_2,
    Transparency=Slider(0.561, range=0..1),
    Shine=Slider(100, range=0..100))
num_8 = Number(0)
expression_9 = Expression(Expression="Format(\"(π*x^4)/20\", x)")
# radii if r/t = 10
eval_7 = Evaluate(F=expression_7, x=division)
# these areas
eval_8 = Evaluate(F=expression_8, x=multiplication_4)
move = Move(Geometry=rotax_2.Geometry, Motion=vec2pt.Vector)  # -> Geometry, Transform
move_2 = Move(Geometry=rotax.Geometry, Motion=vec2pt_2.Vector)  # -> Geometry, Transform
preview = CustomPreview(Geometry=move.Geometry, Material=material_2)
# check above min
larger = LargerThan(FirstNumber=eval_8, SecondNumber=division)  # -> LargerThan, OrEqualTo
# I = pi r^3 t = pi r^4/20
# check above min I
eval_9 = Evaluate(F=expression_9, x=eval_7)
preview_2 = CustomPreview(Geometry=move_2.Geometry, Material=material_2)
panel_10 = Panel(abs_3)
panel_11 = Panel(eval_9)
# R to meet I, from I = AR^2
expression_10 = Expression(Expression="Format(\"(x/y)^0.5\", x,y)")
larger_2 = LargerThan(FirstNumber=eval_9, SecondNumber=abs_3)  # -> LargerThan, OrEqualTo
# final areas
num_9 = Number(0)
expression_11 = Expression(Expression="Format(\"π*x^2\", x)")
max_3 = Maximum(A=num_9, B=division)
# lengths
len_2 = Length(Curve=ln_2)
num_10 = Number(0.05)
not = GateNot(A=larger_2.OrEqualTo)
num_11 = Number(larger_2.OrEqualTo)
multiplication_5 = Multiplication(A=max_3, B=len_2)
# volume
ma = MassAddition(Input=multiplication_5)  # -> Result, PartialResults
num_12 = Number(not)
num_13 = Number(7840)
eval_10 = Evaluate(F=expression_10, x=abs_3, y=division)
expression_12 = Expression(Expression="Format(\"(x*9.81/1000)/(120*60)\", x)")
num_14 = Number(1000)
# mass (kg)
multiplication_6 = Multiplication(A=ma.Result, B=num_13)
eval_11 = Evaluate(F=expression_11, x=num_10)
panel_12 = Panel(num_12)
panel_13 = Panel(num_11)
division_2 = Division(A=multiplication_6, B=num_14)
multiplication_7 = Multiplication(A=eval_10, B=panel_12)
multiplication_8 = Multiplication(A=eval_7, B=panel_13)
panel_14 = Panel(multiplication_7)
# self weight (kPa)
eval_12 = Evaluate(F=expression_12, x=multiplication_6)
# Final radii
addition_3 = Addition(A=multiplication_7, B=multiplication_8)
panel_15 = Panel(eval_12)
# If not, sufficient, need to increase R. Keeping R/t=20 will work, but use more area than required.
multiplication_9 = Multiplication(A=num_3, B=addition_3)
# min section radii
max_4 = Maximum(A=max_2, B=multiplication_9)
max_5 = Maximum(A=max_4, B=num_8)
pipe = Pipe(Curve=crv, Radius=max_5, Caps=0)
rotax_3 = RotateAxis(Geometry=pipe, Angle=rad_2, Axis=line)  # -> Geometry, Transform
rotax_4 = RotateAxis(Geometry=pipe, Angle=rad, Axis=line)  # -> Geometry, Transform
move_3 = Move(Geometry=rotax_3.Geometry, Motion=vec2pt.Vector)  # -> Geometry, Transform
move_4 = Move(Geometry=rotax_4.Geometry, Motion=vec2pt_2.Vector)  # -> Geometry, Transform
preview_3 = CustomPreview(Geometry=move_3.Geometry, Material=material)
preview_4 = CustomPreview(Geometry=move_4.Geometry, Material=material)
# Final compression
panel_16 = Panel(multiplication_9)
